# Dynamo graph PLACE and ROTATE GROUP_script.dyn (Dynamo 3.3.0.6316)
# packages: Data-Shapes 2025.3.119

code_block = CodeBlock { "Select Path for array"; "Select Path"; 0; true; }
selectmodelelements_data = Custom[SelectModelElements Data](InputName=code_block.out0, ButtonText=code_block.out1, SelectSingleElement=code_block.out3)  # package Data-Shapes
code_block_2 = CodeBlock { "Select Group to array"; "Select Group"; 0; true; }
selectmodelelements_data_2 = Custom[SelectModelElements Data](InputName=code_block_2.out0, ButtonText=code_block_2.out1, SelectSingleElement=code_block_2.out3)
code_block_3 = CodeBlock { "Spacing"; "0"; true; }
textbox_data = Custom[TextBox Data](InputName=code_block_3.out0, DefaultText=code_block_3.out1, IsNumberEntry=code_block_3.out2)  # package Data-Shapes
code_block_4 = CodeBlock { "Offset"; "1"; true; }
textbox_data_2 = Custom[TextBox Data](InputName=code_block_4.out0, DefaultText=code_block_4.out1, IsNumberEntry=code_block_4.out2)
code_block_5 = CodeBlock { "Adjust Rotation"; "0"; true; }
textbox_data_3 = Custom[TextBox Data](InputName=code_block_5.out0, DefaultText=code_block_5.out1, IsNumberEntry=code_block_5.out2)
list_create = List.Create(item0=selectmodelelements_data, item1=selectmodelelements_data_2, item2=textbox_data, item3=textbox_data_2, item4=textbox_data_3)
code_block_6 = CodeBlock { true; "xx"; "xx"; "xx"; "xx"; "xx"; "xx"; "xx"; }
multipleinputform = Custom[MultipleInputForm ++](Inputs=list_create, Toggle=code_block_6.out0)  # package Data-Shapes
code_block_7 = CodeBlock(L=multipleinputform.User_Inputs) { Path_ = L[0]; Groups = L[1]; _Spacing_=L[2]; L[3]; L[4]; }
curves = Element.Curves(element=code_block_7.Path_)
code_block_8 = CodeBlock(a=curves) { a; }
code_block_9 = CodeBlock(fist=code_block_7.out3) { a=fist; a+1; }
pointAtSegmentLength = Curve.PointAtSegmentLength(curve=code_block_8, segmentLength=code_block_9.a)
pointsAtSegmentLengthFromPoint = Curve.PointsAtSegmentLengthFromPoint(curve=code_block_8, point=pointAtSegmentLength, segmentLength=code_block_7._Spacing_)
groupType = Group.GroupType(group=code_block_7.Groups)
placeInstance = Group.PlaceInstance(location=pointsAtSegmentLengthFromPoint, groupType=groupType)
flatten = List.Flatten(list=placeInstance)
YAxis = Vector.YAxis()
pointAtSegmentLength_2 = Curve.PointAtSegmentLength(curve=code_block_8, segmentLength=code_block_9.out1)
pointsAtSegmentLengthFromPoint_2 = Curve.PointsAtSegmentLengthFromPoint(curve=code_block_8, point=pointAtSegmentLength_2, segmentLength=code_block_7.out3)
byTwoPoints = Vector.ByTwoPoints(start=pointsAtSegmentLengthFromPoint, end=pointsAtSegmentLengthFromPoint_2)
ZAxis = Vector.ZAxis()
add = Point.Add(point=pointsAtSegmentLengthFromPoint, vectorToAdd=ZAxis)
byTwoPoints_2 = Vector.ByTwoPoints(start=pointsAtSegmentLengthFromPoint, end=add)
angleAboutAxis = Vector.AngleAboutAxis(vector=YAxis, otherVector=byTwoPoints, rotationAxis=byTwoPoints_2)
flatten_2 = List.Flatten(list=angleAboutAxis)
add_2 = code_block_7.out4 + flatten_2
python_script = Python(IN[0]=flatten, IN[1]=add_2)  # CPython3
# ---------- python_script.python (41 lines) ----------
import clr
clr.AddReference('RevitAPI')
clr.AddReference('RevitServices')
from Autodesk.Revit.DB import *
from RevitServices.Persistence import DocumentManager
from RevitServices.Transactions import TransactionManager
import math

# Inputs
groups = UnwrapElement(IN[0])  # List of group elements
angles = IN[1]                 # Either a single number or a list of numbers

# Ensure angles is a list
if not isinstance(angles, list):
    angles = [angles] * len(groups)
elif len(angles) == 1:
    angles = angles * len(groups)
elif len(angles) != len(groups):
    OUT = "Error: Angle list must be length 1 or match number of groups"
    raise Exception(OUT)

doc = DocumentManager.Instance.CurrentDBDocument
results = []

TransactionManager.Instance.EnsureInTransaction(doc)

for group, angle_deg in zip(groups, angles):
    location = group.Location
    if isinstance(location, LocationPoint):
        point1 = location.Point
        point2 = XYZ(point1.X, point1.Y, point1.Z + 1)  # Define axis along Z-axis
        axis = Line.CreateBound(point1, point2)
        angle_rad = math.radians(angle_deg)
        ElementTransformUtils.RotateElement(doc, group.Id, axis, angle_rad)
        results.append("Rotated")
    else:
        results.append("Skipped: No valid location")

TransactionManager.Instance.TransactionTaskDone()

OUT = results
# ----------------------------------------
code_block_10 = CodeBlock(a=placeInstance, b=python_script) { [a,b][1]; }
