# Dynamo graph RC_MultiAnnotation_V1_script.dyn (Dynamo 2.16.4.10216)
# packages: ACOPackage 1.0.4, Data-Shapes 2023.2.111, Clockwork for Dynamo 3.x 3.3.0

string = StringInput("Run")
string_2 = StringInput("Select  Rebars")
categories = Categories("OST_Rebar")
selectmodelelements_data = Custom[SelectModelElements Data](InputName=string_2, ButtonText=string_2, CategoryFilter=categories)  # package Data-Shapes; Creates a Revit element selection input for UI.MultipleInputForm++ . Check out www.data-shapes.net for more infos!
categories_2 = Categories("OST_MultiReferenceAnnotations")
all_family_types_of_category = Custom[All Family Types Of Category](category=categories_2)  # package Clockwork for Dynamo 3.x; Gets all family types/symbols of a given category in the model.
name = Family.Name(family=all_family_types_of_category)
code_block = CodeBlock { 0; }
dropdown_data = Custom[DropDown Data](Keys=name, Values=all_family_types_of_category, DefaultValueIndex=code_block)  # package Data-Shapes; Create data for DropDown input in UI.MultiInputForm ++ . Check out www.data-shapes.net for more infos.
code_block_2 = CodeBlock { "Horizontal"; true; }
boolean_input = Custom[Boolean input](InputName=code_block_2.out0, DefaultValue=code_block_2.out1)  # package Data-Shapes; Creates a boolean input for UI.MultipleInputForm ++ . Check out www.data-shapes.net for more infos!
string_3 = StringInput("select point")
selectpointsonface_data = Custom[SelectPointsOnFace data](InputName=string_3, ButtonText=string_3)  # package Data-Shapes; Creates a UI.MultipleInputForm++ input that allows point on face selection
list_create = List.Create(item0=selectmodelelements_data, item1=dropdown_data, item2=boolean_input, item3=selectpointsonface_data)
boolean = BoolSelector(true)
multipleinputform = Custom[MultipleInputForm ++](ButtonText_optional=string, Inputs=list_create, Toggle=boolean)  # package Data-Shapes; Create a form with multiple inputs. see www.data-shapes.net for tutorials and infos!
code_block_3 = CodeBlock(L=multipleinputform.User_Inputs) { rebars = L[0]; typeMultitag = L[1]; tagHead = L[2]; point = L[3]; }
current = Document.Current()
activeView = Document.ActiveView(document=current)
multiRebarAnnotation = ACOSolution.Annotation.MultiRebarAnnotation(typeMultiTag=code_block_3.typeMultitag, rebars=code_block_3.rebars, sectionView=activeView, tagHead=code_block_3.point, dimensionOrigin=code_block_3.point, horizontal=code_block_3.tagHead, lacing=Longest)
