# Dynamo graph Rebar Numbering Setup_script.dyn (Dynamo 2.16.2.5624)

# group: Set Workset to text parameter
code_block = CodeBlock { "Structural Rebar"; }
byName = Category.ByName(name=code_block)
current = Document.Current()
activeView = Document.ActiveView(document=current)
all_elements_of_category_in_view = ElementsOfCategoryInView(Category=byName, View=activeView)
code_block_2 = CodeBlock { "REBAR_Schedule_Notes"; }  # frozen
code_block_3 = CodeBlock { "Workset"; }  # frozen
parameterByName = Parameter.ParameterByName(element=all_elements_of_category_in_view, name=code_block_3)
string_from_object = FromObject(object=parameterByName)
setParameterByName = Element.SetParameterByName(element=all_elements_of_category_in_view, parameterName=code_block_2, value=string_from_object)  # frozen

# group: Rebar Number to Schedules Mark
code_block_4 = CodeBlock { "Schedule Mark"; }
code_block_5 = CodeBlock { "Rebar Number"; }
parameterByName_2 = Parameter.ParameterByName(element=all_elements_of_category_in_view, name=code_block_5)
value = Parameter.Value(parameter=parameterByName_2)
setParameterByName_2 = Element.SetParameterByName(element=all_elements_of_category_in_view, parameterName=code_block_4, value=value)
