# Dynamo graph RC.SetUnobscured_script.dyn (Dynamo 2.16.2.5624)
# packages: Structural Design 2023.4.25

categories = Categories("OST_Rebar")
current = Document.Current()
activeView = Document.ActiveView(document=current)
all_elements_of_category_in_view = ElementsOfCategoryInView(Category=categories, View=activeView)
boolean = BoolSelector(false)
setUnobscuredInView = StructuralDesign.Rebar.Create.SetUnobscuredInView(rebar=all_elements_of_category_in_view, view=activeView, unobscured=boolean)
