# Dynamo graph RC.Show all-all bars in view_script.dyn "RC.Show all_all bars in view)" (Dynamo 2.16.2.5624)
# packages: Dynamo for Rebar 2.0.2

show_all = BoolSelector(false)  # graph input
categories = Categories("OST_Rebar")
current = Document.Current()
activeView = Document.ActiveView(document=current)
all_elements_of_category_in_view = ElementsOfCategoryInView(Category=categories, View=activeView)
code_block = CodeBlock { "Quantity"; }
parameterByName = Parameter.ParameterByName(element=all_elements_of_category_in_view, name=code_block)
value = Parameter.Value(parameter=parameterByName)  # graph output
position = DoubleInput(2)  # graph input
code_block_2 = CodeBlock(a=position) { a-1; }
gt = value > code_block_2
filterByBoolMask = List.FilterByBoolMask(list=all_elements_of_category_in_view, mask=gt)
if_ = RefactoredIf(test=show_all, true=all_elements_of_category_in_view, false=filterByBoolMask.in, lacing=Longest)
code_block_3 = CodeBlock(max=value) { 0..max-1..1; }
code_block_4 = CodeBlock { false; }
setBarHiddenStatus = Rebar.SetBarHiddenStatus(rebar=if_, view=activeView, barIndex=code_block_3, hidden=code_block_4, lacing=Longest)
