# Dynamo graph RC.Show all-all bars in view_script.dyn (Dynamo 2.16.4.10216)
# packages: Dynamo for Rebar 2.0.2

categories = Categories("OST_Rebar")
current = Document.Current()
activeView = Document.ActiveView(document=current)
all_elements_of_category_in_view = ElementsOfCategoryInView(Category=categories, View=activeView)

# group: set >1
code_block = CodeBlock { "Quantity"; }
parameterByName = Parameter.ParameterByName(element=all_elements_of_category_in_view, name=code_block)
value = Parameter.Value(parameter=parameterByName)  # graph output
position = DoubleInput(1)  # graph input
gt = value > position

filterByBoolMask = List.FilterByBoolMask(list=all_elements_of_category_in_view, mask=gt)
code_block_2 = CodeBlock { "Quantity"; }
parameterByName_2 = Parameter.ParameterByName(element=filterByBoolMask.in, name=code_block_2)
value_2 = Parameter.Value(parameter=parameterByName_2)  # graph output
code_block_3 = CodeBlock(max=value_2) { 0..max-1..1; }
code_block_4 = CodeBlock { false; }
setBarHiddenStatus = Rebar.SetBarHiddenStatus(rebar=filterByBoolMask.in, view=activeView, barIndex=code_block_3, hidden=code_block_4, lacing=Longest)
code_block_5 = CodeBlock {  }
code_block_6 = CodeBlock { "Quantity"; }
parameterByName_3 = Parameter.ParameterByName(element=filterByBoolMask.out, name=code_block_6)
value_3 = Parameter.Value(parameter=parameterByName_3)  # graph output
